# Grasshopper definition rnd_node.gh (Grasshopper 1.0.7)
# plug-ins: Kangaroo2 Components

radius = Slider(12, range=5..20)
count = Slider(12, range=2..20)
size = GetNumber(radius, AtLeast=1, AtMost=1, Maximum=1.797693135e+308, Minimum=-1.797693135e+308, TreeAccess=False)
count_2 = GetNumber(count, AtLeast=1, AtMost=1, Maximum=1.797693135e+308, Minimum=-1.797693135e+308, TreeAccess=False)
sph = Sphere(Base=PlaneXY(0, 0, 0), Radius=size)
pt = ConstructPoint(XCoordinate=0, YCoordinate=0, ZCoordinate=0)
popgeo = PopulateGeometry(Geometry=sph, Count=count_2, Seed=1)
division = Division(A=size, B=count_2)
ln = Line(StartPoint=pt, EndPoint=popgeo)
mp = MultiPipe(Curves=ln, NodeSize=division, EndOffset=1, StrutSize=1, Segment=0, KinkAngle=0.6, CubeFit=0)
meshsubd = MeshFromSubD(SubD=mp, Density=2)
clean = CombineClean(Meshes=meshsubd)
medges = MeshEdges(Mesh=clean)  # -> NakedEdges, InteriorEdges, NonManifoldEdges
preview = CustomPreview(Geometry=meshsubd, Material=ColourSwatch(SwatchColor=RGB(255, 255, 255)))

# ---- group: convert lines to curves
crv = Curve([medges.NakedEdges, medges.InteriorEdges])

# ----
mesh = Mesh(clean)
context_bake = ContextBake(Geometry=crv)
context_bake_2 = ContextBake(Geometry=mesh)
